# Dynamo custom node Deconstruct Location.dyf (Dynamo 0.9.1.3360)
# category: Ladybug.0|Ladybug
# Get different location data from a location string

# group: load the script
code_block = CodeBlock { "deconstructLocation.py"; }
find_file_and_import_it = Python(IN[0]=code_block)
# ---------- find_file_and_import_it.python (16 lines) ----------
def getPackagePath(packageName):
	import sys
	sys.path.append('C:\Program Files (x86)\IronPython 2.7\Lib')
	import os
	import clr
	clr.AddReference('DynamoCore')
	dynamoPath = clr.References[2].Location.split('\\')[2].replace(' ', '\\')
	appdata = os.getenv('APPDATA')
	return '%s\%s\packages\%s\extra\\'%(appdata, dynamoPath, packageName)

filePath = getPackagePath('Ladybug') + IN[0]

with open(filePath, 'rb') as inf:
    lines = inf.readlines()

OUT = ''.join(lines)
# ----------------------------------------

location = Input(_location: System.Object)  # The output from the importLocation, importEPW or constructLocation component.  This is essentially a list of text summarizing a location on the earth.
python_script_from_string = PythonStringNode(script=find_file_and_import_it, IN[0]=location)
code_block_2 = CodeBlock(out=python_script_from_string) { out[0]; out[1]; out[2]; out[3]; out[4]; }
locationName = Output(code_block_2.out0)
latitude = Output(code_block_2.out1)
longitude = Output(code_block_2.out2)
timeZone = Output(code_block_2.out3)
elevation = Output(code_block_2.out4)
myInput = Input()
myInput_2 = Input(myInput)  # This is my input
myInput_3 = Input(myInput: var..var)  # This is my input
